# Grasshopper definition s5_prediction.gh (Grasshopper 1.0.7)
# plug-ins: Human, MeshEdit Components, Tree8

# ---- group: prepare data for encoder
# CITAdf2020 // Material Hyper-Specificities
# session3_script by Gabriella Rossi
panel = Panel("2")
# Create layers: Red, Green, Blue
# Draw 0 to 4 seed points per layer
rectangle = Rectangle(Plane=PlaneXY(0, 0, 0), XSize=panel, YSize=panel, Radius=0)  # -> Rectangle, Length
dpipeline = DynamicGeometryPipeline(
    LayerFilter="Green",
    TypeFilter="point",
    NameFilter="*",
    GroupByLayer=False,
    GroupByType=False,
    IncludeHidden=True,
    IncludeLocked=True,
    enableFullPath=False,
    listenToAttributes=True)
dpipeline_2 = DynamicGeometryPipeline(
    LayerFilter="Red",
    TypeFilter="point",
    NameFilter="*",
    GroupByLayer=False,
    GroupByType=False,
    IncludeHidden=True,
    IncludeLocked=True,
    enableFullPath=False,
    listenToAttributes=True)
dpipeline_3 = DynamicGeometryPipeline(
    LayerFilter="Blue",
    TypeFilter="point",
    NameFilter="*",
    GroupByLayer=False,
    GroupByType=False,
    IncludeHidden=True,
    IncludeLocked=True,
    enableFullPath=False,
    listenToAttributes=True)
crv = Curve(rectangle.Rectangle)
mesh_uv = MeshSurface(Surface=crv, UCount="128", VCount="128", Overhang=True, Equalize=False)
pt = Point(dpipeline_2)
pt_2 = Point(dpipeline)
pt_3 = Point(dpipeline_3)
explode = MeshExplode(Mesh=mesh_uv, Interpolate=False)
area = Area(Geometry=explode)  # -> Area, Centroid
cp = ClosestPoint(Point=pt, Cloud=area.Centroid)  # -> ClosestPoint, CPIndex, Distance
cp_2 = ClosestPoint(Point=pt_2, Cloud=area.Centroid)  # -> ClosestPoint, CPIndex, Distance
cp_3 = ClosestPoint(Point=pt_3, Cloud=area.Centroid)  # -> ClosestPoint, CPIndex, Distance
# 1. Encode input
mesh = Mesh(mesh_uv)
cps = ClosestPoints(Point=cp_3.ClosestPoint, Cloud=area.Centroid, Count="9")  # -> ClosestPoint, flatten(CPIndex), Distance
cps_2 = ClosestPoints(Point=cp.ClosestPoint, Cloud=area.Centroid, Count="9")  # -> ClosestPoint, flatten(CPIndex), Distance
cps_3 = ClosestPoints(Point=cp_2.ClosestPoint, Cloud=area.Centroid, Count="9")  # -> ClosestPoint, flatten(CPIndex), Distance
green_idx = Data(cps_3.CPIndex)
blue_idx = Data(cps.CPIndex)
red_idx = Data(cps_2.CPIndex)

# ---- group: encoder
green_idx_2 = Data(green_idx)
red_idx_2 = Data(red_idx)
blue_idx_2 = Data(blue_idx)

# ----
red_idx_3 = Data(red_idx_2)
green_idx_3 = Data(green_idx_2)
blue_idx_3 = Data(blue_idx_2)
sqr = Square(Value="128")
dup = DuplicateData(Data="0", Number=sqr, Order=True)
replace = ReplaceItems(List=dup, Item="1", Indices=red_idx_3, Wrap=False)
replace_2 = ReplaceItems(List=dup, Item="1", Indices=green_idx_3, Wrap=False)
replace_3 = ReplaceItems(List=dup, Item="1", Indices=blue_idx_3, Wrap=False)
red = Data(replace)
green = Data(replace_2)
blue = Data(replace_3)
merge = Merge(Data1=simplify(graft(red)), Data2=simplify(graft(green)), Data3=simplify(graft(blue)))  # -> flatten(Result)
frgb = ColourRGBF(Alpha=1, Red=red, Green=green, Blue=blue)  # -> simplify(graft(Colour))
join = TextJoin(Text=merge, Join=" ")
file_path = FilePath("D:\Google Drive\__ TRABAJO\IAAC-MACAD\3-AIA-COMPUTER VISION\SESSION 05 - PCA\PREDICTION MODEL\")
path = FilePath("C:\tmp\MLDE\")

# ---- group: compile data
bool = Boolean(Toggle(True))
export_robotmotion_3_r3_multi = PythonScript(toggle=bool, path=file_path, x=join)
# ---------- export_robotmotion_3_r3_multi: Python ----------
#script by Gabriella Rossi / CITA
import os
from os import listdir
from os.path import isfile, join
from scriptcontext import sticky as st

if True:
    try:
        original_umask = os.umask(0)
        if not os.path.exists(path):
            os.makedirs(path)
    finally:
        os.umask(original_umask)


if True:
    #Create file
    filename = str(path) + "query.txt"
    fil = open(filename, 'w')

    fil.write(x)


    fil.close()
# ---------- end export_robotmotion_3_r3_multi ----------

# ---- group: Visualize input flat
mesh_2 = Mesh(mesh)
explode_2 = MeshExplode(Mesh=mesh_2, Interpolate=False)
demesh = DeconstructMesh(Mesh=explode_2)  # -> Vertices, Faces, Colours, Normals
data = Data(frgb)
conmesh = ConstructMesh(Vertices=simplify(demesh.Vertices), Faces=simplify(demesh.Faces), Colours=data)
mjoin = MeshJoin(Meshes=flatten(conmesh))

# ----
# 2. Generate prediction
# You can use hops for this / Or anaconda / or colab, whatever you prefer
panel_2 = Panel(" ")
boolean_toggle = BooleanToggle(True)  # disabled
run_network = GhPythonScript(x=boolean_toggle)  # disabled
# ---------- run_network: Python ----------
#Script by Gabriella Rossi / CITA

import os

if True:
    os.system(r'C:\tmp\MLDE\run.bat')
# ---------- end run_network ----------
# 3. Get prediction in Grasshopper
panel_3 = Panel(" ")

# ---- group: visualize on mesh
file_path_2 = FilePath("C:\tmp\MLDE\pred_image.png")
import_image = ImportImage(File=file_path_2)
demesh_2 = DeconstructMesh(Mesh=import_image)  # -> Vertices, Faces, Colours, Normals

# ----
file = ReadFile(File="C:\tmp\MLDE\prediction.txt", PerLineParse=True)
partition = PartitionList(List=file, Size=Slider(16384, range=0..100000))  # -> simplify(Chunks)
tbranch = TreeBranch(Tree=partition, Path="0", MaintainPaths=True, SplitTree=False)
partition_2 = PartitionList(List=tbranch, Size="128")  # -> simplify(Chunks)
data_2 = Data(simplify(graft(demesh_2.Colours)))
X = UnitX(Factor="2.5")
Y = UnitY(Factor="2")
addition = Addition(A=X, B=Y)

# ---- group: Visualize input flat
mesh_3 = Mesh(mesh)

# ----
explode_3 = MeshExplode(Mesh=mesh_3, Interpolate=False)

# ---- group: Visualize input flat (continued)
demesh_3 = DeconstructMesh(Mesh=explode_3)  # -> Vertices, Faces, Colours, Normals
conmesh_2 = ConstructMesh(Vertices=simplify(demesh_3.Vertices), Faces=simplify(demesh_3.Faces), Colours=data_2)
mjoin_2 = MeshJoin(Meshes=flatten(conmesh_2))

# ----
move = Move(Geometry=mjoin_2, Motion=X)  # -> Geometry, Transform
